# Grasshopper definition PUTA_MERDA.gh (Grasshopper 1.0.8)

polygon = Polygon(Plane=PlaneXY(0, 0, 0), Radius=Slider(17, range=0..100), Segments=Slider(6, range=0..10), FilletRadius=0)  # -> Polygon, Length
explode = Explode(Curve=polygon.Polygon, Recursive=True)  # -> Segments, Vertices
number_slider = Slider(0, range=0..1)
list_item = ListItem(List=explode.Segments, Index=Slider(1, range=0..5), Wrap=True)
length = Length(Curve=list_item)
boolean_toggle = BooleanToggle(False)
subtraction = Subtraction(A=length, B=number_slider)
evaluate_length = EvaluateLength(Curve=list_item, Length=subtraction, Normalized=boolean_toggle)  # -> Point, Tangent, Parameter
# Origami Pattern Definiton
evaluate_length_2 = EvaluateLength(Curve=list_item, Length=number_slider, Normalized=boolean_toggle)  # -> Point, Tangent, Parameter
number_slider_2 = Slider(12, range=0..100)
deconstruct = Deconstruct(Point=[evaluate_length_2.Point, evaluate_length.Point])  # -> XComponent, YComponent, ZComponent
construct_point = ConstructPoint(XCoordinate=deconstruct.XComponent, YCoordinate=deconstruct.YComponent, ZCoordinate=number_slider_2)
radians = Radians(Degrees=Slider(60, range=0..100))
rotate = Rotate(Geometry=construct_point, Angle=radians, Plane=PlaneXY(0, 0, 0))  # -> Geometry, Transform
list_item_2 = ListItem(List=rotate.Geometry, Index=Slider(1, range=0..1), Wrap=True)
multiplication = Multiplication(A=number_slider, B=Slider(2, range=0..10))
boolean_toggle_2 = BooleanToggle(True)
list_item_3 = ListItem(List=rotate.Geometry, Index=Slider(0, range=0..100), Wrap=True)
unit_z = UnitZ(Factor=multiplication)
point = Point([evaluate_length_2.Point, list_item_2, list_item_3])
move = Move(Geometry=point, Motion=unit_z)  # -> Geometry, Transform
polyline = PolyLine(Vertices=[list_item_2, evaluate_length.Point, evaluate_length_2.Point], Closed=boolean_toggle_2)
polyline_2 = PolyLine(Vertices=move.Geometry, Closed=boolean_toggle_2)
list_item_4 = ListItem(List=move.Geometry, Index=Slider(1, range=0..1), Wrap=True)
deconstruct_2 = Deconstruct(Point=list_item_4)  # -> XComponent, YComponent, ZComponent

curve = Curve(polyline_2)
offset_curve = OffsetCurve(Curve=curve, Distance=Slider(-1.5, range=-1.5..0), Corners=1)
deconstruct_plane = DeconstructPlane(Plane=curve)  # -> Origin, XAxis, YAxis, ZAxis
amplitude = Amplitude(Vector=deconstruct_plane.ZAxis, Amplitude=[Slider(-0.3, range=-2..2), Slider(0.3, range=-2..2)])
join_curves = JoinCurves(Curves=offset_curve, Preserve=False)
amplitude_2 = Amplitude(Vector=deconstruct_plane.ZAxis, Amplitude=[Slider(0.01, range=-2..2), Slider(-0.66, range=-2..2)])
extrude = Extrude(Base=join_curves, Direction=amplitude_2)  # disabled
extrude_2 = Extrude(Base=curve, Direction=amplitude)

curve_2 = Curve(polyline)
offset_curve_2 = OffsetCurve(Curve=curve_2, Distance=Slider(-1.5, range=-1.5..0), Corners=1)
deconstruct_plane_2 = DeconstructPlane(Plane=curve_2)  # -> Origin, XAxis, YAxis, ZAxis
amplitude_3 = Amplitude(Vector=deconstruct_plane_2.ZAxis, Amplitude=[Slider(-0.3, range=-2..2), Slider(0.3, range=-2..2)])
join_curves_2 = JoinCurves(Curves=offset_curve_2, Preserve=False)
amplitude_4 = Amplitude(Vector=deconstruct_plane_2.ZAxis, Amplitude=[Slider(0.01, range=-2..2), Slider(0.01, range=-2..2)])
extrude_3 = Extrude(Base=join_curves_2, Direction=amplitude_4)  # disabled
extrude_4 = Extrude(Base=curve_2, Direction=amplitude_3)

unit_z_2 = UnitZ(Factor=Slider(-10, range=-10..100))
unit_z_3 = UnitZ(Factor=Slider(74, range=0..100))
number_slider_3 = Slider(0, range=0..2)

number_slider_4 = Slider(-6, range=-20..-1)
xy_plane = XYPlane(Origin=Point(0, 0, 0))
circle = Circle(Plane=xy_plane, Radius=Slider(22.8, range=0..100))
unit_z_4 = UnitZ(Factor=number_slider_4)
extrude_5 = Extrude(Base=circle, Direction=unit_z_4)
multiplication_2 = Multiplication(A=number_slider_4, B=Slider(-1, range=-1..0))
multiplication_3 = Multiplication(A=number_slider_2, B=Slider(4, range=0..10))
cap_holes = CapHoles(Brep=extrude_5)
addition = Addition(A=multiplication_3, B=number_slider_3, C=multiplication_2)
unit_z_5 = UnitZ(Factor=addition)
move_2 = Move(Geometry=cap_holes, Motion=unit_z_5)  # -> Geometry, Transform

circle_2 = Circle(Plane=PlaneXY(0, 0, 0), Radius=Slider(3, range=0..10))
circle_3 = Circle(Plane=PlaneXY(0, 0, 0), Radius=Slider(3, range=0..10))
unit_z_6 = UnitZ(Factor=multiplication_3)
move_3 = Move(Geometry=circle_2, Motion=unit_z_6)  # -> Geometry, Transform
move_4 = Move(Geometry=circle_3, Motion=unit_z_2)  # -> Geometry, Transform
extrude_6 = Extrude(Base=move_3.Geometry, Direction=unit_z_6)
extrude_7 = Extrude(Base=move_4.Geometry, Direction=unit_z_3)
cap_holes_2 = CapHoles(Brep=extrude_6)  # disabled
cap_holes_3 = CapHoles(Brep=extrude_7)
solid_difference = SolidDifference(BrepsA=move_2.Geometry, BrepsB=cap_holes_3)

number_slider_5 = Slider(0, range=0..100)
addition_2 = Addition(A=number_slider_3, B=deconstruct_2.ZComponent)
cap_holes_4 = CapHoles(Brep=[extrude_4, extrude_3])
number_slider_6 = Slider(2, range=0..10)
cap_holes_5 = CapHoles(Brep=[extrude_2, extrude])
unit_z_7 = UnitZ(Factor=1)
construct_point_2 = ConstructPoint(XCoordinate=number_slider_5, YCoordinate=number_slider_5, ZCoordinate=addition_2)
brep = Brep([cap_holes_4, cap_holes_5])
multiplication_4 = Multiplication(A=number_slider_2, B=number_slider_6)
plane_normal = PlaneNormal(Origin=construct_point_2, ZAxis=unit_z_7)
mirror = Mirror(Geometry=brep, Plane=plane_normal)  # -> Geometry, Transform
number_slider_7 = Slider(2, range=0..10)
geometry = Geometry(solid_difference)
unit_z_8 = UnitZ(Factor=multiplication_4)
brep_2 = Brep([brep, mirror.Geometry])
brep_3 = Brep(<brep referenced from the Rhino model>)
linear_array = LinearArray(Geometry=brep_2, Direction=unit_z_8, Count=number_slider_7)  # -> Geometry, Transform

number = Number(number_slider_7)
number_2 = Number(number_slider_2)
number_3 = Number(number_slider_6)
number_4 = Number(number_slider_4)
multiplication_5 = Multiplication(A=number_4, B=Slider(-1, range=-1..0))

brep_join = BrepJoin(Breps=brep_3)  # -> Breps, Closed
polar_array = PolarArray(
    Geometry=[linear_array.Geometry, mirror.Geometry],
    Plane=PlaneXY(0, 0, 0),
    Count=Slider(6, range=0..10),
    Angle=6.283185307)  # -> Geometry, Transform
geometry_2 = Geometry(linear_array.Geometry)
custom_preview = CustomPreview(Geometry=geometry_2, Material=ColourSwatch(SwatchColor=RGB(255, 255, 161)))
geometry_3 = Geometry(brep_join.Breps)
geometry_4 = Geometry(polar_array.Geometry)
custom_preview_2 = CustomPreview(Geometry=geometry_4, Material=ColourSwatch(SwatchColor=RGB(161, 161, 161)))
custom_preview_3 = CustomPreview(Geometry=geometry_3, Material=ColourSwatch(SwatchColor=RGB(161, 161, 161)))

brep_4 = Brep(<brep referenced from the Rhino model>)
unit_z_9 = UnitZ(Factor=Slider(8.4, range=-30..30))

scale = Scale(Geometry=brep_4, Center=Point(0, 0, 0), Factor=Slider(1.25, range=0.5..2))  # -> Geometry, Transform

move_5 = Move(Geometry=scale.Geometry, Motion=unit_z_9)  # -> Geometry, Transform

addition_3 = Addition(A=number_3, B=number)
multiplication_6 = Multiplication(A=number_2, B=addition_3)
addition_4 = Addition(A=multiplication_6, B=multiplication_5)
number_5 = Number(addition_4)
unit_z_10 = UnitZ(Factor=number_5)
linear_array_2 = LinearArray(Geometry=[move_2.Geometry, geometry_4, move_5.Geometry], Direction=unit_z_10, Count=Slider(1, range=0..10))  # -> Geometry, Transform

brep_5 = Brep([geometry_4, solid_difference, geometry, move_5.Geometry])
geometry_5 = Geometry([linear_array_2.Geometry, geometry])

brep_6 = Brep(<brep referenced from the Rhino model>)
unit_z_11 = UnitZ(Factor=Slider(8.4, range=-30..30))

scale_2 = Scale(Geometry=brep_6, Center=Point(0, 0, 0), Factor=Slider(1.25, range=0.5..2))  # -> Geometry, Transform

move_6 = Move(Geometry=scale_2.Geometry, Motion=unit_z_11)  # -> Geometry, Transform
